# Grasshopper definition 240621_bulldog_metadata.gh (Grasshopper 1.0.7)
# plug-ins: DendroGH, Weaverbird, Kangaroo2 Components

tongue_length = Slider(10, range=0..100)
outer_loft_position = Slider(55.07, range=0..100)
split_plane_position = Slider(100, range=0..500)
inner_loft_position = Slider(31.044, range=0..100)

# ---- group: STL file input
path = FilePath()  # disabled

# ----
voxel_size = Slider(0.5, range=0..1)
socket_thickness = Slider(4.5, range=0..10)
# Input your STL here
encodedfile = GetString(AtLeast=1, AtMost=1, TreeAccess=False)
flip_cut_body = BooleanToggle(True)
# RUNNING BOND
# ENGLISH BOND
# BRICK DATA
# HEADER BOND
coarse_fine = BooleanToggle(True)
run_dendro = BooleanToggle(False)
enable_split = BooleanToggle(False)
jagged = SettingsSpeed()
smooth = SettingsQuality()

# ---- group: set true for Compute
file_data = BooleanToggle(True)

# ----
path_2 = CSharpScript(path=path)  # -> out, A; inputs path: String
# ---------- path_2: C# ----------
    if( null == path ) return;

    var doc = RhinoDoc.CreateHeadless(null);
    doc.Import(path);

    var mesh = new Rhino.Geometry.Mesh();

    Rhino.DocObjects.RhinoObject[] meshObjects = doc.Objects.FindByObjectType(Rhino.DocObjects.ObjectType.Mesh);

    foreach(Rhino.DocObjects.RhinoObject mo in meshObjects)
      mesh.Append(mo.Geometry as Rhino.Geometry.Mesh);

    A = mesh;
# ---------- end path_2 ----------
c_script = CSharpScript(data=encodedfile, ext=".stl")  # -> out, A; inputs data: String, ext: String
# ---------- c_script: C# usings ----------
using System.IO;
# ---------- c_script: C# ----------
    if( null == data || null == ext ) return;

    var decodedData = Convert.FromBase64String(data);

    var tmpPath = Path.GetTempFileName();
    tmpPath = Path.ChangeExtension(tmpPath, ext);

    File.WriteAllBytes(tmpPath, decodedData);

    if(File.Exists(tmpPath))
    {
      var doc = Rhino.RhinoDoc.CreateHeadless(null);
      doc.Import(tmpPath);

      var mesh = new Rhino.Geometry.Mesh();

      Rhino.DocObjects.RhinoObject[] meshObjects = doc.Objects.FindByObjectType(Rhino.DocObjects.ObjectType.Mesh);

      foreach(Rhino.DocObjects.RhinoObject mo in meshObjects)
        mesh.Append(mo.Geometry as Rhino.Geometry.Mesh);

      A = mesh;
    }
# ---------- end c_script ----------
preview_dimensions = BooleanToggle(True)
preview_split_planes = BooleanToggle(True)
inner_loft_position_2 = GetNumber(inner_loft_position, AtLeast=1, AtMost=1, Maximum=1.797693135e+308, Minimum=-1.797693135e+308, TreeAccess=False)
preview_lock_body = BooleanToggle(True)
socket_thickness_2 = GetNumber(socket_thickness, AtLeast=1, AtMost=1, Maximum=1.797693135e+308, Minimum=-1.797693135e+308, TreeAccess=False)
outer_loft_position_2 = GetNumber(outer_loft_position, AtLeast=1, AtMost=1, Maximum=1.797693135e+308, Minimum=-1.797693135e+308, TreeAccess=False)
preview_cut_body = BooleanToggle(True)
split_plane_position_2 = GetInteger(split_plane_position, AtLeast=1, AtMost=1, Maximum=2147483647, Minimum=-2147483648, TreeAccess=False)
tongue_length_2 = GetInteger(tongue_length, AtLeast=1, AtMost=1, Maximum=2147483647, Minimum=-2147483648, TreeAccess=False)
# Aaron:
# should be one input
preview_single = BooleanToggle(True)
preview_upper = BooleanToggle(False)
preview_socket = BooleanToggle(True)
preview_lower = BooleanToggle(False)
preview_lofts = BooleanToggle(True)
preview_ring = BooleanToggle(True)
voxel_size_2 = GetNumber(voxel_size, AtLeast=1, AtMost=1, Maximum=1.797693135e+308, Minimum=-1.797693135e+308, TreeAccess=False)
flip_cut_body_2 = GetBoolean(flip_cut_body, AtLeast=1, AtMost=1, FalseValue="False", TreeAccess=False, TrueValue="True")
enable_split_2 = GetBoolean(enable_split, AtLeast=1, AtMost=1, FalseValue="False", TreeAccess=False, TrueValue="True")
run_dendro_2 = GetBoolean(run_dendro, AtLeast=1, AtMost=1, FalseValue="False", TreeAccess=False, TrueValue="True")
filter = StreamFilter(Gate=coarse_fine, Stream0=jagged, Stream1=smooth)
filter_2 = StreamFilter(Gate=file_data, Stream0=path_2.A, Stream1=c_script.A)

# ---- group: IMPORT
panel = Panel("Socket")
mesh = Mesh(filter_2)

# ----
pt = ConstructPoint(XCoordinate=0, YCoordinate=split_plane_position_2, ZCoordinate=0)

# ---- group: INTERNAL
panel_2 = Panel("Lock Body")
panel_3 = Panel("Ring")
panel_4 = Panel("CutBody")
brep = Brep(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)
brep_2 = Brep(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)
brep_3 = Brep(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)

# ----
xz = XZPlane(Origin=pt)
clean = CombineClean(Meshes=mesh)
rectangle = Rectangle(Plane=xz, XSize="-100 to 100", YSize="-100 to 100", Radius=0)  # -> Rectangle, Length
mplane = MeshPlane(Boundary=rectangle.Rectangle, WidthCount="1", HeightCount="1")  # -> Mesh, Area
swatch = ColourSwatch(SwatchColor=RGBA(13, 99, 0, 150))
swatch_2 = ColourSwatch(SwatchColor=RGBA(0, 94, 99, 150))
neg = Negative(Value=tongue_length_2)
cull = CullPattern(List=brep, CullPattern=preview_ring)
cull_2 = CullPattern(List=brep_2, CullPattern=preview_lock_body)
Y = UnitY(Factor=[tongue_length_2, neg])
move = Move(Geometry=mplane.Mesh, Motion=Y)  # -> Geometry, Transform
preview = CustomPreview(Geometry=cull, Material=swatch_2)
preview_2 = CustomPreview(Geometry=cull_2, Material=swatch)
mesh_2 = MeshBrep(Brep=cull_2, Settings=filter)
mesh_3 = MeshBrep(Brep=cull, Settings=filter)

# ---- group: must be a string
uservalue = Text("Input Mesh")
userkey = Text("name")

# ----
cull_3 = CullPattern(List=move.Geometry, CullPattern=preview_split_planes)
swatch_3 = ColourSwatch(SwatchColor=RGBA(0, 43, 99, 150))
mcol = MeshColours(Mesh=mesh_3, Colours=swatch_2)
mcol_2 = MeshColours(Mesh=mesh_2, Colours=swatch)
c_script_2 = CSharpScript(geometry=clean, userKey=userkey, userValue=uservalue)  # -> out, geoWithUserString; inputs geometry: GeometryBase, userKey: String, userValue: String
# ---------- c_script_2: C# ----------
    if(geometry != null)
    {geometry.SetUserString(userKey, userValue);
      geoWithUserString = geometry;
    }else return;
# ---------- end c_script_2 ----------

# ---- group: must be a string
uservalue_2 = Text("Lock Body")
userkey_2 = Text("name")

uservalue_3 = Text("Ring")
userkey_3 = Text("name")

# ----
mcol_3 = MeshColours(Mesh=cull_3, Colours=swatch_3)
preview_3 = CustomPreview(Geometry=cull_3, Material=swatch_3)
edges = BrepEdges(Brep=brep)  # -> Naked, Interior, NonManifold
num = Number(flip_cut_body_2)

# ---- group: PUFFERFISH OFFSET
cluster = Cluster(mesh=clean, distance=socket_thickness_2, closed=Toggle(False))
wbjoin = WeaverbirdsJoinMeshesAndWeld(Mesh=cluster, Weld=Toggle(True))

# ----
pt_2 = ConstructPoint(XCoordinate=0, YCoordinate=outer_loft_position_2, ZCoordinate=0)
xz_2 = XZPlane(Origin=Point(0, 0, 0))
c_script_3 = CSharpScript(geometry=mcol_2, userKey=userkey_2, userValue=uservalue_2)  # -> out, geoWithUserString; inputs geometry: GeometryBase, userKey: String, userValue: String; same code as c_script_2
c_script_4 = CSharpScript(geometry=mcol, userKey=userkey_3, userValue=uservalue_3)  # -> out, geoWithUserString; inputs geometry: GeometryBase, userKey: String, userValue: String; same code as c_script_2
pi = Pi(Factor=num)
edges_2 = BrepEdges(Brep=brep_2)  # -> Naked, Interior, NonManifold
midpt = CurveMiddle(Curve=edges.Interior)
xz_3 = XZPlane(Origin=pt_2)

# ---- group: must be a string
uservalue_4 = Text("Split Planes")
userkey_4 = Text("name")

# ----
context_bake = ContextBake(InputMesh=c_script_2.geoWithUserString)
medges = MeshEdges(Mesh=clean)  # -> NakedEdges, InteriorEdges, NonManifoldEdges
rotate = Rotate(Geometry=brep_3, Angle=pi, Plane=xz_2)  # -> Geometry, Transform
pdecon = Deconstruct(Point=midpt)  # -> XComponent, YComponent, ZComponent
midpt_2 = CurveMiddle(Curve=edges_2.Interior)
join = JoinCurves(Curves=medges.NakedEdges, Preserve=False)
pt_3 = ConstructPoint(XCoordinate=0, YCoordinate=inner_loft_position_2, ZCoordinate=0)
c_script_5 = CSharpScript(geometry=mcol_3, userKey=userkey_4, userValue=uservalue_4)  # -> out, geoWithUserString; inputs geometry: GeometryBase, userKey: String, userValue: String; same code as c_script_2
unim = UnifyMesh(Mesh=wbjoin)  # -> Result, Count
sort = SortList(Keys=pdecon.YComponent, ValuesA=edges.Interior)  # -> Keys, ValuesA
cull_4 = CullPattern(List=rotate.Geometry, CullPattern=preview_cut_body)
context_bake_2 = ContextBake(LockBody=c_script_3.geoWithUserString)
context_bake_3 = ContextBake(Geometry=c_script_4.geoWithUserString)
pdecon_2 = Deconstruct(Point=midpt_2)  # -> XComponent, YComponent, ZComponent
item = ListItem(List=sort.ValuesA, Index=0, Wrap=True)
xz_4 = XZPlane(Origin=pt_3)
len = Length(Curve=join)
mesh_4 = Mesh(unim.Result)
medges_2 = MeshEdges(Mesh=mesh_4)  # -> NakedEdges, InteriorEdges, NonManifoldEdges
join_2 = JoinCurves(Curves=medges_2.NakedEdges, Preserve=False)
len_2 = Length(Curve=join_2)
sort_2 = SortList(Keys=pdecon_2.YComponent, ValuesA=edges_2.Interior)  # -> Keys, ValuesA
swatch_4 = ColourSwatch(SwatchColor=RGBA(45, 0, 99, 150))
sec = MeshPlane(Mesh=mesh_4, Plane=xz_3)
sort_3 = SortList(Keys=len_2, ValuesA=join_2)  # -> Keys, ValuesA
mesh_5 = MeshBrep(Brep=cull_4, Settings=filter)
sec_2 = MeshPlane(Mesh=clean, Plane=xz_4)
sort_4 = SortList(Keys=len, ValuesA=join)  # -> Keys, ValuesA
pt_4 = ConstructPoint(XCoordinate=0, YCoordinate=0, ZCoordinate=0)
context_bake_4 = ContextBake(SplitPlanes=c_script_5.geoWithUserString)
item_2 = ListItem(List=reverse(sort_2.ValuesA), Index=0, Wrap=True)  # -> Item, Item1
item_3 = ListItem(List=reverse(sort_3.ValuesA), Index=0, Wrap=True)
item_4 = ListItem(List=reverse(sort_4.ValuesA), Index=0, Wrap=True)
len_3 = Length(Curve=sec)
crv_cp = CurveClosestPoint(Point=pt_4, Curve=item)  # -> Point, Parameter, Distance
item_5 = ListItem(List=sec_2, Index=0, Wrap=True)
mcol_4 = MeshColours(Mesh=mesh_5, Colours=swatch_4)
join_3 = JoinCurves(Curves=flatten([item_2.Item, item_2.Item1]), Preserve=False)
sort_5 = SortList(Keys=len_3, ValuesA=sec)  # -> Keys, ValuesA
pt_5 = ConstructPoint(XCoordinate=0, YCoordinate=0, ZCoordinate=0)
pt_6 = ConstructPoint(XCoordinate=0, YCoordinate=0, ZCoordinate=0)
crv = Curve(item_3)
subtraction = Subtraction(A=split_plane_position_2, B=tongue_length_2)
addition = Addition(A=split_plane_position_2, B=tongue_length_2)
crv_2 = Curve(item_5)
crv_3 = Curve(item_4)
item_6 = ListItem(List=reverse(sort_5.ValuesA), Index=0, Wrap=True)
crv_cp_2 = CurveClosestPoint(Point=crv_cp.Point, Curve=item_6)  # -> Point, Parameter, Distance
crv_4 = Curve(join_3)
crv_cp_3 = CurveClosestPoint(Point=pt_6, Curve=crv)  # -> Point, Parameter, Distance
preview_4 = CustomPreview(Geometry=cull_4, Material=swatch_4)
seam = Seam(Curve=item, Seam=crv_cp.Parameter)
crv_cp_4 = CurveClosestPoint(Point=pt_5, Curve=crv_2)  # -> Point, Parameter, Distance

# ---- group: must be a string
uservalue_5 = Text("Cut Body")
userkey_5 = Text("name")

# ----
seam_2 = Seam(Curve=item_6, Seam=crv_cp_2.Parameter)
crv_cp_5 = CurveClosestPoint(Point=crv_cp_3.Point, Curve=crv_3)  # -> Point, Parameter, Distance
crv_cp_6 = CurveClosestPoint(Point=crv_cp_4.Point, Curve=crv_4)  # -> Point, Parameter, Distance
divide = DivideCurve(Curve=seam_2, Count="100", Kinks=False)  # -> Points, Tangents, Parameters
divide_2 = DivideCurve(Curve=seam, Count="100", Kinks=False)  # -> Points, Tangents, Parameters
pt_7 = ConstructPoint(XCoordinate=0, YCoordinate=subtraction, ZCoordinate=0)
pt_8 = ConstructPoint(XCoordinate=0, YCoordinate=addition, ZCoordinate=0)
c_script_6 = CSharpScript(geometry=mcol_4, userKey=userkey_5, userValue=uservalue_5)  # -> out, geoWithUserString; inputs geometry: GeometryBase, userKey: String, userValue: String; same code as c_script_2
seam_3 = Seam(Curve=crv_3, Seam=crv_cp_5.Parameter)
seam_4 = Seam(Curve=crv_2, Seam=crv_cp_4.Parameter)
seam_5 = Seam(Curve=crv, Seam=crv_cp_3.Parameter)
seam_6 = Seam(Curve=crv_4, Seam=crv_cp_6.Parameter)
intcrv = Interpolate(Vertices=divide_2.Points, Degree=3, Periodic="True", KnotStyle=1)  # -> Curve, Length, Domain
intcrv_2 = Interpolate(Vertices=divide.Points, Degree=3, Periodic="True", KnotStyle=1)  # -> Curve, Length, Domain
divide_3 = DivideCurve(Curve=seam_6, Count="100", Kinks=False)  # -> Points, Tangents, Parameters
divide_4 = DivideCurve(Curve=seam_4, Count="100", Kinks=False)  # -> Points, Tangents, Parameters
divide_5 = DivideCurve(Curve=seam_3, Count="100", Kinks=False)  # -> Points, Tangents, Parameters
divide_6 = DivideCurve(Curve=seam_5, Count="100", Kinks=False)  # -> Points, Tangents, Parameters
flip = FlipCurve(Curve=intcrv_2.Curve, Guide=intcrv.Curve)  # -> Curve, Flag
context_bake_5 = ContextBake(Geometry=c_script_6.geoWithUserString)
intcrv_3 = Interpolate(Vertices=divide_4.Points, Degree=3, Periodic="True", KnotStyle=1)  # -> Curve, Length, Domain
intcrv_4 = Interpolate(Vertices=divide_3.Points, Degree=3, Periodic="True", KnotStyle=1)  # -> Curve, Length, Domain
intcrv_5 = Interpolate(Vertices=divide_6.Points, Degree=3, Periodic="True", KnotStyle=1)  # -> Curve, Length, Domain
intcrv_6 = Interpolate(Vertices=divide_5.Points, Degree=3, Periodic="True", KnotStyle=1)  # -> Curve, Length, Domain
merge = Merge(Data1=intcrv.Curve, Data2=flip.Curve)  # -> simplify(flatten(Result))
flip_2 = FlipCurve(Curve=intcrv_4.Curve, Guide=intcrv_3.Curve)  # -> Curve, Flag
flip_3 = FlipCurve(Curve=intcrv_6.Curve, Guide=intcrv_5.Curve)  # -> Curve, Flag
loft = Loft(Curves=merge, Options={Adjust=False, Closed=False, LoftEnds=0, LoftSimp=0, LoftType=0, Rebuild=10, Refit=0.01})
merge_2 = Merge(Data1=intcrv_3.Curve, Data2=flip_2.Curve)  # -> simplify(flatten(Result))
tweencrv = TweenCurve(CurveA=intcrv_5.Curve, CurveB=flip_3.Curve, Factor=0.5, BlendType=0)
swatch_5 = ColourSwatch(SwatchColor=RGBA(99, 0, 10, 150))
cull_5 = CullPattern(List=loft, CullPattern=preview_lofts)
division = Division(A=socket_thickness_2, B="2")
loft_2 = Loft(Curves=merge_2, Options={Adjust=False, Closed=False, LoftEnds=0, LoftSimp=0, LoftType=0, Rebuild=10, Refit=0.01})
cull_6 = CullPattern(List=loft_2, CullPattern=preview_lofts)

# ---- group: PUFFERFISH OFFSET
cluster_2 = Cluster(mesh=clean, distance=division, closed="True")
wbjoin_2 = WeaverbirdsJoinMeshesAndWeld(Mesh=cluster_2, Weld=Toggle(True))
unim_2 = UnifyMesh(Mesh=wbjoin_2)  # -> Result, Count

# ----
preview_5 = CustomPreview(Geometry=cull_5, Material=swatch_5)
divide_7 = DivideCurve(Curve=tweencrv, Count="100", Kinks=False)  # -> Points, Tangents, Parameters

# ---- group: PUFFERFISH OFFSET
cluster_3 = Cluster(mesh=clean, distance=socket_thickness_2, closed="True")
wbjoin_3 = WeaverbirdsJoinMeshesAndWeld(Mesh=cluster_3, Weld=Toggle(True))
unim_3 = UnifyMesh(Mesh=wbjoin_3)  # -> Result, Count

# ----
merge_3 = Merge(Data1=unim_3.Result, Data2=brep)  # -> flatten(Result)
bbox = BoundingBox(Content=merge_3, Plane=PlaneXY(0, 0, 0), UnionBox=True)  # -> Box, Box_2
mesh_6 = Mesh(bbox.Box)
demesh = DeconstructMesh(Mesh=mesh_6)  # -> Vertices, Faces, Colours, Normals
pdecon_3 = Deconstruct(Point=demesh.Vertices)  # -> XComponent, YComponent, ZComponent
bnd = Bounds(Numbers=pdecon_3.YComponent)
dedomain = DeconstructDomain(Domain=bnd)  # -> Start, End
pt_9 = ConstructPoint(XCoordinate=0, YCoordinate=dedomain.Start, ZCoordinate=0)
pt_10 = ConstructPoint(XCoordinate=0, YCoordinate=dedomain.End, ZCoordinate=0)
ln = Line(StartPoint=pt_9, EndPoint=pt_10)
ln_2 = Line(StartPoint=pt_9, EndPoint=pt_8)
ln_3 = Line(StartPoint=pt_10, EndPoint=pt_7)
merge_4 = Merge(Data1=ln, Data2=ln_3, Data3=ln_2)
lng = ListLength(List=merge_4)
series = Series(Start="100", Step="50", Count=lng)
dist = Distance(PointA=pt_9, PointB=pt_10)
dist_2 = Distance(PointA=pt_8, PointB=pt_9)
dist_3 = Distance(PointA=pt_7, PointB=pt_9)
X = UnitX(Factor=series)
division_2 = Division(A=dist_3, B=dist)
division_3 = Division(A=dist_2, B=dist)
move_2 = Move(Geometry=merge_4, Motion=X)  # -> Geometry, Transform

# ---- group: DRAW DIMENSIONS
panel_5 = Panel("0.00")
xy = XYPlane(Origin=Point(0, 0, 0))
panel_6 = Panel("true")
panel_7 = Panel("10")
line = Line(move_2.Geometry)

# ----
cap = CapHoles(Brep=loft)
preview_6 = CustomPreview(Geometry=cull_6, Material=ColourSwatch(SwatchColor=RGBA(99, 0, 10, 150)))
intcrv_7 = Interpolate(Vertices=divide_7.Points, Degree=3, Periodic="True", KnotStyle=1)  # -> flatten(Curve), Length, Domain
cap_2 = CapHoles(Brep=loft_2)
scale_nu = ScaleNU(Geometry=mesh_6, Plane=pt_9, ScaleX=1, ScaleY=division_3, ScaleZ=1)  # -> Geometry, Transform
scale_nu_2 = ScaleNU(Geometry=mesh_6, Plane=pt_9, ScaleX=1, ScaleY=division_2, ScaleZ=1)  # -> Geometry, Transform
mesh_7 = MeshBrep(Brep=cap, Settings=filter)

# ---- group: CLOSE MESH
cluster_4 = Cluster_2(mesh=clean)
wbjoin_4 = WeaverbirdsJoinMeshesAndWeld(Mesh=cluster_4, Weld=Toggle(True))

# ----
smooth_2 = SettingsQuality()
cluster_5 = Cluster_3(
    _3dtext=panel_6,
    computesquid=True,
    base_crv=line,
    dimension_offset="0",
    text_size=panel_7,
    textbaseplane=xy,
    txtformat=panel_5,
    mark_size=panel_7)  # -> txtloc_2, finaltxt_2, _3d_dimensions_2
mesh_8 = MeshBrep(Brep=cap_2, Settings=smooth_2)
division_4 = Division(A=socket_thickness_2, B="2")
swatch_6 = ColourSwatch(SwatchColor=RGBA(99, 0, 41, 150))
cull_7 = CullPattern(List=unim_3.Result, CullPattern=preview_socket)
pipe = Pipe(Curve=intcrv_7.Curve, Radius=division_4, Caps=0)  # -> flatten(Pipe)
mcol_5 = MeshColours(Mesh=mesh_7, Colours=swatch_5)
smooth_3 = SettingsQuality()
mcol_6 = MeshColours(Mesh=cull_7, Colours=swatch_6)
cull_8 = CullPattern(List=flatten(cluster_5._3d_dimensions_2), CullPattern=preview_dimensions)
mesh_9 = MeshBrep(Brep=rotate.Geometry, Settings=smooth_3)
mesh_10 = MeshBrep(Brep=pipe, Settings=smooth_3)
preview_7 = CustomPreview(Geometry=mcol_6, Material=swatch_6)
clean_2 = CleanTree(RemoveNulls=True, RemoveInvalid=True, RemoveEmpty=False, Tree=cull_8)

# ---- group: must be a string
uservalue_6 = Text("Inner Loft")
userkey_6 = Text("name")

# ----
c_script_7 = CSharpScript(geometry=mesh_8, userKey=userkey_6, userValue=uservalue_6)  # -> out, geoWithUserString; inputs geometry: GeometryBase, userKey: String, userValue: String; same code as c_script_2

# ---- group: must be a string
uservalue_7 = Text("Outer Loft")
userkey_7 = Text("name")

uservalue_8 = Text("Dims")
userkey_8 = Text("name")

uservalue_9 = Text("Socket")
userkey_9 = Text("name")

# ----
c_script_8 = CSharpScript(geometry=mcol_5, userKey=userkey_7, userValue=uservalue_7)  # -> out, geoWithUserString; inputs geometry: GeometryBase, userKey: String, userValue: String; same code as c_script_2
vsettings = CreateSettings(VoxelSize=voxel_size_2, Bandwidth=1, Isovalue=0, Adaptivity=0.1)
c_script_9 = CSharpScript(geometry=mcol_6, userKey=userkey_9, userValue=uservalue_9)  # -> out, geoWithUserString; inputs geometry: GeometryBase, userKey: String, userValue: String; same code as c_script_2
c_script_10 = CSharpScript(geometry=clean_2, userKey=userkey_8, userValue=uservalue_8)  # -> out, geoWithUserString; inputs geometry: GeometryBase, userKey: String, userValue: String; same code as c_script_2
context_bake_6 = ContextBake(InnerLoft=c_script_7.geoWithUserString)
cull_9 = CullPattern(List=vsettings, CullPattern=run_dendro_2)
context_bake_7 = ContextBake(OuterLoft=c_script_8.geoWithUserString)
bool = Boolean(enable_split_2)
context_bake_8 = ContextBake(Geometry=c_script_9.geoWithUserString)
context_bake_9 = ContextBake(Geometry=c_script_10.geoWithUserString)
cull_10 = CullPattern(List=cull_9, CullPattern=bool)

# ---- group: SKIN THICK HALF
vmesh = MeshToVolume(Mesh=unim_2.Result, Settings=cull_10)

# ---- group: BB LARGE
vmesh_2 = MeshToVolume(Mesh=scale_nu.Geometry, Settings=cull_10)

# ---- group: OUTER LOFT
vmesh_3 = MeshToVolume(Mesh=mesh_7, Settings=cull_9)

# ---- group: INNER VOL
vmesh_4 = MeshToVolume(Mesh=wbjoin_4, Settings=cull_9)

# ---- group: INNER LOFT
vmesh_5 = MeshToVolume(Mesh=mesh_8, Settings=cull_9)

# ---- group: CUT BODY
vmesh_6 = MeshToVolume(Mesh=mesh_9, Settings=cull_9)

# ---- group: BB SMALL
vmesh_7 = MeshToVolume(Mesh=scale_nu_2.Geometry, Settings=cull_10)

# ---- group: OUTER RIM
vmesh_8 = MeshToVolume(Mesh=mesh_10, Settings=cull_9)

# ---- group: SKIN THICK FULL
vmesh_9 = MeshToVolume(Mesh=unim_3.Result, Settings=cull_9)

# ----
cull_11 = CullPattern(List=vmesh_9, CullPattern=bool)
python = GhPythonScript(x=flatten([vmesh_4, vmesh_5]))  # -> out, a; inputs x: list
# ---------- python: Python ----------
if  len(x) ==0:
    a = True
else: a = False
# ---------- end python ----------
python_2 = GhPythonScript(x=flatten([vmesh_9, vmesh_3]))  # -> out, a; inputs x: list; same code as python
vdiff = VolumeDifference(VolumeA=cull_11, VolumesB=vmesh_2)
filter_3 = StreamFilter(Gate=python_2.a, Stream0=flatten([vmesh_9, vmesh_3]))
filter_4 = StreamFilter(Gate=python.a, Stream0=flatten([vmesh_4, vmesh_5]))
vdiff_2 = VolumeDifference(VolumeA=vmesh, VolumesB=vmesh_7)
cull_12 = CullPattern(List=vmesh_8, CullPattern=bool)
vunion = VolumeUnion(Volumes=flatten(filter_3))
vunion_2 = VolumeUnion(Volumes=flatten(filter_4))
python_3 = GhPythonScript(x=flatten(cull_12))  # -> out, a; inputs x: list; same code as python
vdiff_3 = VolumeDifference(VolumeA=vunion, VolumesB=vunion_2)
filter_5 = StreamFilter(Gate=python_3.a, Stream0=flatten([vmesh_8, vdiff, vdiff_2]))
vdiff_4 = VolumeDifference(VolumeA=vdiff_3, VolumesB=vmesh_6)
vunion_3 = VolumeUnion(Volumes=flatten(filter_5))
vdiff_5 = VolumeDifference(VolumeA=vdiff_4, VolumesB=vunion_3)
not = GateNot(A=bool)
cull_13 = CullPattern(List=flatten([vdiff_4, vmesh_8]), CullPattern=not)
vsmooth = SmoothVolume(Volume=vunion_3, Width=1, Type=2, Iterations=1)
vsmooth_2 = SmoothVolume(Volume=vdiff_5, Width=1, Type=2, Iterations=1)
vunion_4 = VolumeUnion(Volumes=flatten(cull_13))
clean_3 = CleanTree(RemoveNulls=True, RemoveInvalid=True, RemoveEmpty=False, Tree=vunion_4)
vsmooth_3 = SmoothVolume(Volume=clean_3, Width=1, Type=2, Iterations=1)

# ---- group: EXPORT STL
mvolume = VolumeToMesh(Volume=vsmooth_2, VolumeSettings=cull_9)
mvolume_2 = VolumeToMesh(Volume=vsmooth, VolumeSettings=cull_9)
lower_mesh = Mesh(mvolume)
upper_mesh = Mesh(mvolume_2)

# ----
mvolume_3 = VolumeToMesh(Volume=vsmooth_3, VolumeSettings=cull_9)

# ---- group: SINGLE MESH
lower_mesh_2 = Mesh(mvolume_3)

# ----
swatch_7 = ColourSwatch(SwatchColor=RGB(180, 66, 255))
mcol_7 = MeshColours(Mesh=upper_mesh, Colours=swatch_7)
mcol_8 = MeshColours(Mesh=lower_mesh_2, Colours=swatch_7)
mcol_9 = MeshColours(Mesh=lower_mesh, Colours=swatch_7)
cull_14 = CullPattern(List=mvolume_3, CullPattern=preview_single)
preview_8 = CustomPreview(Geometry=cull_14, Material=swatch_7)
uservalue_10 = Text("Upper Mesh")

# ---- group: must be a string
uservalue_11 = Text("Single Mesh")
userkey_10 = Text("name")

# ----
uservalue_12 = Text("Lower Mesh")
c_script_11 = CSharpScript(geometry=mcol_9, userKey=userkey_10, userValue=uservalue_12)  # -> out, geoWithUserString; inputs geometry: GeometryBase, userKey: String, userValue: String; same code as c_script_2
c_script_12 = CSharpScript(geometry=mcol_8, userKey=userkey_10, userValue=uservalue_11)  # -> out, geoWithUserString; inputs geometry: GeometryBase, userKey: String, userValue: String; same code as c_script_2
c_script_13 = CSharpScript(geometry=mcol_7, userKey=userkey_10, userValue=uservalue_10)  # -> out, geoWithUserString; inputs geometry: GeometryBase, userKey: String, userValue: String; same code as c_script_2
cull_15 = CullPattern(List=mvolume, CullPattern=preview_lower)
cull_16 = CullPattern(List=mvolume_2, CullPattern=preview_upper)
context_bake_10 = ContextBake(LowerMesh=c_script_11.geoWithUserString)
context_bake_11 = ContextBake(UpperMesh=c_script_13.geoWithUserString)
context_bake_12 = ContextBake(SingleMesh=c_script_12.geoWithUserString)
preview_9 = CustomPreview(Geometry=cull_15, Material=swatch_7)
preview_10 = CustomPreview(Geometry=cull_16, Material=swatch_7)

# ==== cluster Cluster
both_sides = ClusterInput()
closed = ClusterInput()
distance = ClusterInput()
mesh = ClusterInput()
closed_2 = Boolean(closed)
both_sides_2 = Number(both_sides)
distance_2 = Number(distance)
mesh_2 = Mesh(mesh)
demesh = DeconstructMesh(Mesh=mesh_2)  # -> Vertices, Faces, Colours, Normals
null = NullItem(Item=both_sides_2)  # -> NullFlags, InvalidFlags, Description
neg = Negative(Value=both_sides_2)
amp = Amplitude(Vector=demesh.Normals, Amplitude=distance_2)
amp_2 = Amplitude(Vector=demesh.Normals, Amplitude=neg)
move = Move(Geometry=demesh.Vertices, Motion=amp)  # -> Geometry, Transform
move_2 = Move(Geometry=demesh.Vertices, Motion=amp_2)  # -> Geometry, Transform
conmesh = ConstructMesh(Vertices=move.Geometry, Faces=demesh.Faces)
conmesh_2 = ConstructMesh(Vertices=move_2.Geometry, Faces=demesh.Faces)
p_n_c = PickNChoose(Pattern=null.NullFlags, Stream0=conmesh_2, Stream1=mesh_2)
cull = CullPattern(List=conmesh, CullPattern=closed_2)
cull_2 = CullPattern(List=p_n_c, CullPattern=closed_2)
medges = MeshEdges(Mesh=cull)  # -> NakedEdges, InteriorEdges, NonManifoldEdges
medges_2 = MeshEdges(Mesh=cull_2)  # -> NakedEdges, InteriorEdges, NonManifoldEdges
flip = FlipCurve(Curve=medges_2.NakedEdges)  # -> Curve, Flag
merge = Merge(Data1=simplify(graft(medges.NakedEdges)), Data2=simplify(graft(flip.Curve)))
cp = ControlPoints(Curve=merge)  # -> simplify(Points), Weights, Knots
quad = MeshQuad(CornerA=0, CornerB=1, CornerC=2, CornerD=3)  # -> flatten(Face)
trim = TrimTree(Tree=cp.Points, Depth=1)
conmesh_3 = ConstructMesh(Vertices=trim, Faces=quad)
toggle = BooleanToggle(True)
merge_2 = Merge(Data1=conmesh, Data2=p_n_c, Data3=conmesh_3)  # -> flatten(Result)
clean = CleanTree(RemoveNulls=toggle, RemoveInvalid=toggle, RemoveEmpty=toggle, Tree=merge_2)
mjoin = MeshJoin(Meshes=clean)
offset = Mesh(mjoin)
offset_2 = ClusterOutput(offset)

# ==== cluster Cluster_2
mesh = ClusterInput()
mesh_2 = Mesh(mesh)
medges = MeshEdges(Mesh=mesh_2)  # -> NakedEdges, InteriorEdges, NonManifoldEdges
join = JoinCurves(Curves=medges.NakedEdges, Preserve=False)
cls = Closed(Curve=join)  # -> Closed, Periodic
cull = CullPattern(List=join, CullPattern=cls.Closed)
f_fmesh = FastMesh(P=cull)  # -> M; inputs P: list of Polyline
# ---------- f_fmesh: C# usings ----------
using System.IO;
using System.Linq;
using System.Data;
using System.Drawing;
using System.Reflection;
using System.Windows.Forms;
using System.Xml;
using System.Xml.Linq;
using System.Runtime.InteropServices;

using Rhino.DocObjects;
using Rhino.Collections;
using GH_IO;
using GH_IO.Serialization;
# ---------- f_fmesh: C# ----------
         /*
    froGH - a sparse collection of (in)utilities for Grasshopper

    Fast mesh from closed polyline

    parallelization occurs after 10.000 elements

    base  code by James Ramsden - http://james-ramsden.com/fastmesh-v2-the-stupidly-easy-way-of-creating-efficient-meshes-from-polylines/
    parallel implementation by Alessio Erioli

    froGH by Co-de-iT is licensed under a Creative Commons Attribution 4.0 International License.
    http://creativecommons.org/licenses/by/4.0/

    */

    initComp();


    if (P.Count < 10000){ // change the number if you want to change parallelization threshold
      List<Mesh> m = new List<Mesh>();

      for (int i = 0; i < P.Count(); i++){
        m.Add(Rhino.Geometry.Mesh.CreateFromClosedPolyline(P[i]));
      }

      M = m;

    }else{


      var mp = new System.Collections.Concurrent.ConcurrentDictionary<Polyline, Mesh>(Environment.ProcessorCount, P.Count);
      foreach (Polyline p in P) mp[p] = new Mesh(); //initialise dictionary

      System.Threading.Tasks.Parallel.ForEach(P, p =>
        {
        mp[p] = Rhino.Geometry.Mesh.CreateFromClosedPolyline(p); //save your output here
        }
        );

      M = mp.Values;
    }
# ---------- f_fmesh: C# additional code ----------
  void initComp(){
    Component.Name = "Fast Mesh";
    Component.NickName = "f_FMesh";
    Component.Description = "Creates a fast mesh from a closed polyline";
    Component.Params.Input[0].Name = "Polyline";
    Component.Params.Input[0].Description = "Closed polylines (list works faster)";
    Component.Params.Output[0].Name = "Mesh";
    Component.Params.Output[0].Description = "Fast and cheap Mesh";
  }
# ---------- end f_fmesh ----------
mjoin = MeshJoin(Meshes=flatten([f_fmesh, mesh_2]))
M = ClusterOutput(mjoin)

# ==== cluster Cluster_3
dimension_offset = ClusterInput()
computesquid = ClusterInput()  # Do you want to compute the dimensions to be used in squid to create bitmaps?
textbaseplane = ClusterInput()
mark_style = ClusterInput()  # 0 = Arrow, 1 = Line
txtformat = ClusterInput()  # Add decimals to your dimesion by using 0.0, 0.00, etc.
mark_size = ClusterInput()
text_size = ClusterInput()
base_crv = ClusterInput()  # List of curves (Normally lines or arcs)
_3dtext = ClusterInput()  # Do you want to generate the 3D text of the dimensions?

# ---- group: Inputs
dimension_offset_2 = Number(simplify(graft(dimension_offset)))
textbaseplane_2 = Plane(simplify(graft(textbaseplane)))
mark_size_2 = Number(simplify(graft(mark_size)))
txtformat_2 = Text(simplify(graft(txtformat)))
text_size_2 = Number(simplify(graft(text_size)))
computesquid_2 = Boolean(computesquid)
mark_style_2 = Integer(mark_style)
_3dtext_2 = Boolean(_3dtext)

# ----
base_crv_2 = Curve(simplify(graft(base_crv)))
lng = ListLength(List=flatten(base_crv_2))  # -> expr("x-1", Length)
morethanonedim = Boolean(lng)
filter = StreamFilter(Gate=mark_style_2, Stream0=mark_size_2, Stream1=0)
offset = OffsetCurve(Curve=base_crv_2, Distance=dimension_offset_2, Plane=textbaseplane_2, Corners=1)  # -> simplify(Curve)
num = Number(offset)
eval = Evaluate(F="If (x≤(y*3),x,x-y)", x=num, y=filter)
eval_2 = Evaluate(F="If (x≤(y*3),0,y)", x=num, y=filter)
eval_3 = EvaluateLength(Curve=offset, Length=0.5, Normalized=True)  # -> Point, Tangent, Parameter
eval_4 = EvaluateLength(Curve=offset, Length=[eval_2, eval], Normalized=False)  # -> Point, Tangent, Parameter
deplane = DeconstructPlane(Plane=textbaseplane_2)  # -> Origin, XAxis, YAxis, ZAxis
abs = Absolute(Value=eval_3.Tangent)
abs_2 = Absolute(Value=deplane.XAxis)
pl_origin = PlaneOrigin(Base=textbaseplane_2, Origin=eval_3.Point)
shatter = Shatter(Curve=offset, Parameters=eval_4.Parameter)
angle = Angle(VectorA=abs, VectorB=abs_2)  # -> Angle, Reflex
orient = Orient(Geometry=Point(0, 0, 0), Source=PlaneXY(0, 0, 0), Target=pl_origin)  # -> Geometry, Transform
item = ListItem(List=shatter, Index=1, Wrap=True)  # -> simplify(Item)
line = Line(Line((-0.5, -0.25, 0), (0.5, 0.25, 0)))
rev = Reverse(Vector=deplane.ZAxis)
num_2 = Number(expr("x/2", text_size_2))
bool = Boolean(angle.Angle)
filter_2 = StreamFilter(Gate=0)

# ---- group: Create and Place Text
len = Length(Curve=base_crv_2)
concat = Concatenate(FragmentA="Format(\"{0:", FragmentB=txtformat_2, FragmentC="}\", x)")
eval_5 = Evaluate(F=concat, x=len)

# ----
clean = CleanTree(RemoveNulls=True, RemoveInvalid=True, RemoveEmpty=False, Tree=len, SynchronousTree1=eval_5)  # -> Tree, SynchronousTree1
null = NullItem(Item=len)  # -> NullFlags, InvalidFlags, Description
finaltxt = Text(clean.SynchronousTree1)
finaltxt_2 = ClusterOutput(finaltxt)

# ---- group: Create and Place Text (continued)
c_mesh_grammar_converter = CSharpScript(
    gm=[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],
    gl=[0.9797768667, 0.2552301213, 0.4379358143, 0.7942817248, 0.6694560722, 1.112970747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],
    gt=["Ø", "!", "\"", "#", "$", "%", "&", "'", "(", ")"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],
    loc=PlaneXY(0, 0, 0),
    txt=clean.SynchronousTree1,
    w=text_size_2,
    h=0)  # -> out, simplify(A); inputs gm: list of Mesh, gl: list of Double, gt: list of String, loc: list of Plane, txt: list of String, w: Double, h: Double
# ---------- c_mesh_grammar_converter: C# ----------
    double notFoundSpacing = 0.3;
    double foundSpacing = 0.1;

    if ( gm.Count != gt.Count || gm.Count != gl.Count )
      return;
    int jmax = gm.Count;
    if ( loc.Count != txt.Count )
      return;

    List<Mesh> meshes = new List<Mesh>();

    for (int i=0, imax = loc.Count; i < imax; i++)
    {
      string t = txt[i];
      Plane l = loc[i];
      Mesh mi = new Mesh();
      double shift = 0;

      while (t.Length > 0) {
        bool bFound = false;
        for (int j = 0; j < jmax; j++)
        {
          if ( t.StartsWith(gt[j]))
          {
            Mesh mj = gm[j].DuplicateMesh();
            mj.Transform(Transform.Translation(new Vector3d(shift, 0, 0)));
            mi.Append(mj);
            shift += gl[j] + foundSpacing;
            bFound = true;
            t = t.Substring(gt[j].Length);
            break;
          }
        }
        if (!bFound) {
          shift += notFoundSpacing;
          t = t.Substring(1);
        }
      }

      // shift to bounding box centre
      mi.Transform(Transform.Translation(new Vector3d(-0.5 * shift, -0.5, 0)));
      mi.Transform(Transform.Scale(Plane.WorldXY, w, w, h));
      mi.Transform(Transform.ChangeBasis(l, Plane.WorldXY));
      meshes.Add(mi);
    }

    A = meshes;
# ---------- end c_mesh_grammar_converter ----------

# ----
match = MatchTree(Tree=c_mesh_grammar_converter.A, Guide=clean.Tree)
filter_3 = StreamFilter(Gate=_3dtext_2, Stream1=match)

# ---- group: Create and Place Text (continued)
bbox = BoundingBox(Content=match, Plane=PlaneXY(0, 0, 0))  # -> Box, Box_2
orient_2 = Orient(Geometry=filter_3, Source=PlaneXY(0, 0, 0), Target=pl_origin)  # -> simplify(Geometry), Transform

# ----
rec = Rectangle(bbox.Box)
cull = CullPattern(List=rec, CullPattern=invert(null.NullFlags))

# ---- group: Place and Flip Arrows when Distance is too small
arrow = Data([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])
eval_6 = EvaluateLength(Curve=offset, Length=[0, 1], Normalized=True)  # -> Point, Tangent, Parameter
xprod = CrossProduct(VectorA=eval_6.Tangent, VectorB=rev, Unitize=True)  # -> Vector, Length
pl = ConstructPlane(Origin=eval_6.Point, XAxis=eval_6.Tangent, YAxis=xprod.Vector)
prot = RotatePlane(Plane=pl, Angle=[1.570796327, -1.570796327])  # -> simplify(graft(Plane))
lng_2 = ListLength(List=prot)

# ----
filter_4 = StreamFilter(Gate=mark_style_2, Stream0=arrow, Stream1=line)
scale_nu = ScaleNU(Geometry=filter_4, Plane=PlaneXY(0, 0, 0), ScaleX=mark_size_2, ScaleY=mark_size_2, ScaleZ=1)  # -> Geometry, Transform

# ---- group: Create Lines
len_2 = Length(Curve=item)

# ---- group: Move aside text if not enough space
dim = Dimensions(Surface=cull)  # -> UDimension, VDimension
deplane_2 = DeconstructPlane(Plane=textbaseplane_2)  # -> Origin, XAxis, YAxis, ZAxis
vrot = Rotate(Vector=eval_3.Tangent, Axis=deplane_2.ZAxis, Angle=1.570796327)

# ----
weave = Weave(Pattern=bool, Stream0=dim.UDimension, Stream1=dim.VDimension, NullGaps=False)
addition = Addition(A=weave, B=num_2)

# ---- group: Move aside text if not enough space (continued)
eval_7 = Evaluate(
    F="If (x<(y+1),If ((Floor(y/10)*10)≈z,(u/2)+(z/2),z),0)",
    x=simplify(len_2),
    y=simplify(weave),
    z=text_size_2,
    u=dim.UDimension)
amp = Amplitude(Vector=vrot, Amplitude=eval_7)
move = Move(Geometry=orient_2.Geometry, Motion=amp)  # -> simplify(Geometry), Transform

# ---- group: Create Lines (continued)
subtraction = Subtraction(A=len_2, B=addition)
num_3 = Number(expr("x/2", subtraction))
merge = Merge(Data1=simplify(num_3), Data2=simplify(addition), Data3=simplify(num_3))
cull_2 = CullPattern(List=merge, CullPattern=invert(eval_7))
cull_3 = CullPattern(List=len_2, CullPattern=eval_7)
dash = DashPattern(Curve=item, Pattern=[cull_3, cull_2], UseTasks=False)  # -> simplify(Dashes), Gaps

# ----
move_2 = Move(Geometry=orient.Geometry, Motion=amp)  # -> Geometry, Transform
txtloc = Point(move_2.Geometry)
txtloc_2 = ClusterOutput(txtloc)

# ---- group: Place and Flip Arrows when Distance is too small (continued)
dup = DuplicateData(Data=scale_nu.Geometry, Number=lng_2, Order=True)  # -> simplify(Data)

# ---- group: Place and Flip Arrows when Distance is too small / Rotate Arrow if segment is too short
trim = TrimTree(Tree=dup, Depth=morethanonedim)
eval_8 = Evaluate(F="If (x≤(y*3),π,0)", x=num, y=filter)
rotate = Rotate(Geometry=trim, Angle=eval_8, Plane=PlaneXY(0, 0, 0))  # -> Geometry, Transform
clean_2 = CleanTree(RemoveNulls=True, RemoveInvalid=True, RemoveEmpty=False, Tree=rotate.Geometry)

# ---- group: Place and Flip Arrows when Distance is too small (continued)
unflatten = UnflattenTree(Tree=clean_2, Guide=dup)
orient_3 = Orient(Geometry=unflatten, Source=PlaneXY(0, 0, 0), Target=prot)  # -> Geometry, Transform
trim_2 = TrimTree(Tree=orient_3.Geometry, Depth=morethanonedim)  # -> simplify(Tree)

# ----
merge_2 = Merge(Data1=move.Geometry, Data2=dash.Dashes, Data3=trim_2)
filter_5 = StreamFilter(Gate=morethanonedim, Stream0=flatten(merge_2), Stream1=merge_2)
_3d_dimensions = Data(filter_5)
_3d_dimensions_2 = ClusterOutput(_3d_dimensions)
